# Grasshopper definition RGDUmbrellaPavilion.gh (Grasshopper 1.0.7)
# plug-ins: NGon

middlecircler = GetInteger(Slider(18, range=0..50), AtLeast=1, AtMost=1, Maximum=2147483647, Minimum=-2147483648, TreeAccess=False)
heightofmiddle = GetInteger(Slider(10, range=0..50), AtLeast=1, AtMost=1, Maximum=2147483647, Minimum=-2147483648, TreeAccess=False)
topcircler = GetInteger(Slider(16, range=0..50), AtLeast=1, AtMost=1, Maximum=2147483647, Minimum=-2147483648, TreeAccess=False)
heightoftop = GetInteger(Slider(12, range=0..20), AtLeast=1, AtMost=1, Maximum=2147483647, Minimum=-2147483648, TreeAccess=False)
basecircler = GetInteger(Slider(6, range=0..50), AtLeast=1, AtMost=1, Maximum=2147483647, Minimum=-2147483648, TreeAccess=False)
divisioncount = GetInteger(Slider(42, range=0..100), AtLeast=1, AtMost=1, Maximum=2147483647, Minimum=-2147483648, TreeAccess=False)
shiftbase = GetInteger(Slider(5, range=0..50), AtLeast=1, AtMost=1, Maximum=2147483647, Minimum=-2147483648, TreeAccess=False)
shiftmiddle = GetInteger(Slider(5, range=0..50), AtLeast=1, AtMost=1, Maximum=2147483647, Minimum=-2147483648, TreeAccess=False)
shiftmiddle1 = GetInteger(Slider(0, range=0..50), AtLeast=1, AtMost=1, Maximum=2147483647, Minimum=-2147483648, TreeAccess=False)

xy = XYPlane(Origin=Point(0, 0, 0))
xy_2 = XYPlane(Origin=Point(0, 0, 0))
xy_3 = XYPlane(Origin=Point(0, 0, 0))
cir = Circle(Plane=xy, Radius=middlecircler)
cir_2 = Circle(Plane=xy_2, Radius=topcircler)
cir_3 = Circle(Plane=xy_3, Radius=basecircler)
Z = UnitZ(Factor=heightofmiddle)
Z_2 = UnitZ(Factor=heightoftop)
move = Move(Geometry=cir, Motion=Z)  # -> Geometry, Transform
move_2 = Move(Geometry=cir_2, Motion=Z_2)  # -> Geometry, Transform
divide = DivideCurve(Curve=[move.Geometry, move_2.Geometry, cir_3], Count=divisioncount, Kinks=False)  # -> Points, Tangents, Parameters
divide_2 = DivideCurve(Curve=[move.Geometry, move_2.Geometry, cir_3], Count=10, Kinks=False)  # -> Points, Tangents, Parameters
bang = ExplodeTree(Data=divide_2.Points)  # -> Branch0, Branch1, Branch2
bang_2 = ExplodeTree(Data=divide.Points)  # -> Branch0, Branch1, Branch2
arc = Arc3Pt(PointA=bang.Branch0, PointB=bang.Branch1, PointC=bang.Branch2)  # -> Arc, Plane, Radius
loft_opt = LoftOptions(Closed="true", Adjust=False, Rebuild=0, Refit=0, Type=0)
reb = RebuildCurve(Curve=arc.Arc, Count=10, Tangents=False)
loft = Loft(Curves=reb, Options=loft_opt)
shift = ShiftList(List=bang_2.Branch2, Shift=shiftbase, Wrap=True)
shift_2 = ShiftList(List=bang_2.Branch0, Shift=shiftmiddle, Wrap=True)
shift_3 = ShiftList(List=bang_2.Branch0, Shift=shiftmiddle1, Wrap=True)
geodesic = Geodesic(Surface=loft, Start=bang_2.Branch0, End=shift)
geodesic_2 = Geodesic(Surface=loft, Start=bang_2.Branch2, End=shift_2)
geodesic_3 = Geodesic(Surface=loft, Start=bang_2.Branch2, End=shift_3)
pipe = Pipe(Curve=[move.Geometry, move_2.Geometry, cir_3], Radius="0.20", Caps=0)  # -> flatten(Pipe); disabled
pipe_2 = Pipe(Curve=[geodesic_2, geodesic, geodesic_3], Radius="0.10", Caps=0)  # -> flatten(Pipe); disabled
offsetmesh = OffsetMesh(Mesh=loft, Dist="0.05", Solid=False)
context_bake = ContextBake(UmbrellaMesh=flatten([offsetmesh, loft]))
context_bake_2 = ContextBake(UmbrellaSupport=flatten([pipe, pipe_2]))  # disabled
panel = Panel("""MiddleCircleR
HeightOfMiddle
TopCircleR
HeightOfTop
BaseCircleR
DivisionCount
ShiftBase
ShiftMiddle
ShiftMiddle1""")
